# Grasshopper definition Site-GH-Revit_Nk.gh (Grasshopper 1.0.7)
# plug-ins: Rhino.Inside for Autodesk Revit, MeshEdit Components

trimmed_v2_site = Mesh(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)
macro = Mesh(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)
meso = Mesh(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)
micro = Mesh(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)

# ----
# Topograhy - Rhino Inside
add_topography_mesh = AddTopographyMesh(Mesh=macro, TrackingMode=2)
add_topography_mesh_2 = AddTopographyMesh(Mesh=meso, TrackingMode=2)
add_topography_mesh_3 = AddTopographyMesh(Mesh=micro, TrackingMode=2)
add_topography_mesh_4 = AddTopographyMesh(Mesh=trimmed_v2_site, TrackingMode=2)

# ----
# Add Material to topography
panel = Panel("Material")
material = Material(<material referenced from the Revit model>)
element_parameter = ElementParameter(
    Element=[add_topography_mesh, add_topography_mesh_2, add_topography_mesh_3, add_topography_mesh_4],
    Parameter=panel,
    Value=material)  # -> Element, Value

# ----
# Assign Project Base point
g14_site = Mesh(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)
project_location = ProjectLocation()  # -> SiteLocation, SharedSite, SurveyPoint, ProjectBasePoint
mesh_area = MeshArea(Mesh=g14_site)  # -> Area, Centroid
element_location = ElementLocation(Element=project_location.ProjectBasePoint, Location=mesh_area.Centroid)  # -> Element, Location, Hand, Facing, WorkPlane

# ----
# Add Levels
bounding_box = BoundingBox(Content=g14_site, Plane=PlaneXY(0, 0, 0))  # -> Box, Box_2
deconstruct_brep = DeconstructBrep(Brep=bounding_box.Box_2)  # -> Faces, Edges, Vertices
list_item = ListItem(List=deconstruct_brep.Faces, Index="4", Wrap=True)  # -> Item, Item1
area = Area(Geometry=list_item.Item)  # -> Area, Centroid
area_2 = Area(Geometry=list_item.Item1)  # -> Area, Centroid
line = Line(StartPoint=area_2.Centroid, EndPoint=area.Centroid)
divide_curve = DivideCurve(Curve=line, Count="15", Kinks=False)  # -> Points, Tangents, Parameters
series = Series(Start=0, Step=1, Count="15")
deconstruct = Deconstruct(Point=divide_curve.Points)  # -> XComponent, YComponent, ZComponent
concatenate = Concatenate(FragmentA="G14_", FragmentB=series)
add_level = AddLevel(
    Elevation=graft(deconstruct.ZComponent),
    Name=graft(concatenate),
    Type=<elementtype referenced from the Revit model>,
    TrackingMode=2)
