# Grasshopper definition To Speckle_Naveen Kumar.gh (Grasshopper 1.0.7)
# Copyright: 2022
# plug-ins: Speckle 2, Bifocals, MetaHopper

panel = Panel("OUTPUT")
panel_2 = Panel("INPUT")
panel_3 = Panel("FUNCTION 01")
panel_4 = Panel("FUNCTION 02")
panel_5 = Panel("FUNCTION 03")
panel_6 = Panel("VISUALIZATION")

panel_7 = Panel("https://macad.speckle.xyz/projects/4975f9f0a8/models/d2c10d6a06")
receive = Receive(
    Stream=panel_7,
    AutoReceive=False,
    CurrentComponentState="expired",
    ExpandOutput=True,
    LastInfoMessage="James McBennett @ 03/01/2024 23:14:17: 2024 Mar-01 (id:9ec35295b2)",
    ReceiveOnOpen=False,
    ReceivedCommitId="9ec35295b2",
    StreamWrapper="https://macad.speckle.xyz/projects/4975f9f0a8/models/d2c10d6a06",
    selectedKitName="Objects")  # -> Info, CONTOURS, SOIL

# ----
# SPECKLE-MATERIAL
panel_8 = Panel("https://macad.speckle.xyz/streams/4975f9f0a8/branches/site%2F05-materials")
receive_2 = Receive(
    Stream=panel_8,
    AutoReceive=True,
    CurrentComponentState="expired",
    ExpandOutput=True,
    LastInfoMessage="James McBennett @ 03/02/2024 01:57:29: Materials 01-03-2024 (id:6ecf38526e)",
    ReceiveOnOpen=True,
    ReceivedCommitId="6ecf38526e",
    StreamWrapper="https://macad.speckle.xyz/projects/4975f9f0a8/models/site/05-materials",
    selectedKitName="Objects")  # -> Info, Materials
dso = DeconstructSpeckleObject(SpeckleObject=receive_2.Materials, selectedKitName="Objects")  # -> Glass, Inflatable, Insulation, Mineral, Regolith, Site, Soil, Steel
glass_material = Data(dso.Glass)
insulation = Data(dso.Insulation)
inflatable = Data(dso.Inflatable)
regolith = Data(dso.Regolith)
mineral = Data(dso.Mineral)
site = Data(dso.Site)
soil = Data(dso.Soil)
steel = Data(dso.Steel)

# ----
# PROJECT
# INPUTS
# BIMSC-PROJECT
panel_9 = Panel("FRAGMENTS OF A MARTIAN ROSE")
bimsc_project = Text(panel_9)

# ----
# BIMSC-ORIGINATOR
panel_10 = Panel("G-14")
bimsc_originator = Text(panel_10)

# ----
# BIMSC-VOLUME
panel_11 = Panel("D1")
bimsc_volume = Text(panel_11)

# ----
# Geomentry_Name
number_slider = Slider(0, range=0..12)
list = ValueList({"Srf/Brep": 0, "Mesh": 1}, selected="Mesh")
filter = StreamFilter(Gate=list)  # -> reverse(simplify(graft(Stream)))
cluster_and_floor_numbering = ClusterAndFloorNumbering(cluster_number=number_slider, start_floor=0, number_of_floor=10)  # -> floor_number_2, cluster_number_3
phase = ControlKnob(Decimals=0, Limit=True, Maximum=20, Minimum=0, Range=20, Value=0)
bimsc_originator_2 = Text(bimsc_originator)
bimsc_project_2 = Text(bimsc_project)
bimsc_volume_2 = Text(bimsc_volume)
name = ExtendSpeckleObject(
    SpeckleObject=filter,
    BIMSCPROJECT=bimsc_project_2,
    BIMSCORIGINATOR=bimsc_originator_2,
    BIMSCVOLUME=bimsc_volume_2,
    BIMSCZONE=cluster_and_floor_numbering.cluster_number_3,
    BIMSCLEVEL=cluster_and_floor_numbering.floor_number_2,
    BIMSCTYPE="Type of Geomentry",
    BIMSCMATERIAL="Material Name",
    BIMSCPHASE=phase,
    selectedKitName="Objects")

bimsc_originator_3 = Text(bimsc_originator)
bimsc_project_3 = Text(bimsc_project)
bimsc_volume_3 = Text(bimsc_volume)
glass_material_2 = Data(glass_material)
insulation_2 = Data(insulation)
inflatable_2 = Data(inflatable)
regolith_2 = Data(regolith)
mineral_2 = Data(mineral)
soil_2 = Data(soil)
steel_2 = Data(steel)
site_2 = Data(site)
panel_12 = Panel("Glass")
panel_13 = Panel("Mineral")
panel_14 = Panel("Site")
panel_15 = Panel("Inflatable")
panel_16 = Panel("Insulation")
panel_17 = Panel("Regolith")
panel_18 = Panel("Soil")
panel_19 = Panel("Steel")

macro = Mesh(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)
meso = Mesh(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)
micro = Mesh(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)
merge = Merge(Data1=macro, Data2=meso, Data3=micro)

trimmed_v2_site = Mesh(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)
g14_site = Mesh(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)
merge_2 = Merge(Data1=trimmed_v2_site, Data2=g14_site)

# ----
# Site
number_slider_2 = Slider(0, range=0..12)
cluster_and_floor_numbering_2 = ClusterAndFloorNumbering(cluster_number=number_slider_2, start_floor=0, number_of_floor=10)  # -> floor_number_2, cluster_number_3
phase_2 = ControlKnob(Decimals=0, Limit=True, Maximum=20, Minimum=0, Range=20, Value=0)
site_3 = Data(site)
bimsc_volume_4 = Text(bimsc_volume)
bimsc_originator_4 = Text(bimsc_originator)
bimsc_project_4 = Text(bimsc_project)
name_2 = ExtendSpeckleObject(
    SpeckleObject=merge_2,
    BIMSCPROJECT=bimsc_project_4,
    BIMSCORIGINATOR=bimsc_originator_4,
    BIMSCVOLUME=bimsc_volume_4,
    BIMSCZONE=cluster_and_floor_numbering_2.cluster_number_3,
    BIMSCLEVEL=cluster_and_floor_numbering_2.floor_number_2,
    BIMSCTYPE="D-14 Site Area",
    BIMSCMATERIAL="Site",
    RenderMaterial=site_3,
    BIMSCPHASE=phase_2,
    selectedKitName="Objects")  # -> flatten(ExtendedSpeckleObject)

mesh_cave_shell = Mesh(flatten(Tree({0;0;0;0;0}: [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], {0;0;0;1;0}: [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], {0;0;0;2;0}: [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], {0;0;0;3;0}: [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], {0;0;0;4;0}: [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], {0;0;0;5;0}: [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], {0;0;0;6;0}: [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], {0;0;0;7;0}: [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], {0;0;0;8;0}: [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], {0;0;0;9;0}: [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], {0;0;0;10;0}: [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])))
cso = CreateSpeckleObject(selectedKitName="Objects")  # -> flatten(SpeckleObject)
cso_2 = CreateSpeckleObject(selectedKitName="Objects")
cso_3 = CreateSpeckleObject(Site=name_2, selectedKitName="Objects")  # -> flatten(SpeckleObject)

concatenate = Concatenate(FragmentA="Rev no -", FragmentB="01")
transit_connection = Panel("")
entwine = Entwine(Branch00=concatenate, Branch01="Date", Branch02="MESSAGE", FlattenInputs=True)
send = Send(
    Stream=transit_connection,
    Message=entwine,
    O=cso,
    AutoSend=False,
    BaseId="732216f3872e5355441df3ad080aeb91",
    CurrentComponentState="expired",
    KitName="Objects",
    OutputWrappers="https://macad.speckle.xyz\t708456778c\tb402470d7a",
    UseDefaultCache=True,
    selectedKitName="Objects")

cso_4 = CreateSpeckleObject(selectedKitName="Objects")
cso_5 = CreateSpeckleObject(selectedKitName="Objects")  # -> flatten(SpeckleObject)

concatenate_2 = Concatenate(FragmentA="Rev no -", FragmentB="01")
mesh_aggregate = Panel("https://macad.speckle.xyz/streams/708456778c/branches/outer%20mesh-aggregation")
entwine_2 = Entwine(Branch00=concatenate_2, Branch01="Date", Branch02="MESSAGE", FlattenInputs=True)
send_2 = Send(
    Stream=mesh_aggregate,
    Message=entwine_2,
    O=cso_2,
    AutoSend=False,
    BaseId="732216f3872e5355441df3ad080aeb91",
    CurrentComponentState="expired",
    KitName="Objects",
    OutputWrappers="https://macad.speckle.xyz\t708456778c\tb402470d7a",
    UseDefaultCache=True,
    selectedKitName="Objects")

concatenate_3 = Concatenate(FragmentA="Rev no -", FragmentB="01")
interior = Panel("https://macad.speckle.xyz/streams/708456778c/branches/outer%20mesh-aggregation%2Fc01")
entwine_3 = Entwine(Branch00=concatenate_3, Branch01="Date", Branch02="MESSAGE", FlattenInputs=True)
send_3 = Send(
    Stream=interior,
    Message=entwine_3,
    O=[cso_5, cso_4],
    AutoSend=False,
    BaseId="732216f3872e5355441df3ad080aeb91",
    CurrentComponentState="expired",
    KitName="Objects",
    OutputWrappers="https://macad.speckle.xyz\t708456778c\tb402470d7a",
    UseDefaultCache=True,
    selectedKitName="Objects")

concatenate_4 = Concatenate(FragmentA="Rev no -", FragmentB="01")
wip = Panel("https://macad.speckle.xyz/streams/708456778c/branches/outer%20mesh-aggregation")
shared = Panel("https://macad.speckle.xyz/streams/708456778c/branches/outer%20mesh-aggregation")
entwine_4 = Entwine(Branch00=concatenate_4, Branch01="Date", Branch02="MESSAGE", FlattenInputs=True)
list_2 = ValueList({"WIP": 0, "Shared": 1}, selected="WIP")
filter_2 = StreamFilter(Gate=list_2, Stream0=wip, Stream1=shared)  # -> reverse(simplify(graft(Stream)))
send_4 = Send(
    Stream=filter_2,
    Message=entwine_4,
    D=[cso, cso_2, cso_5, cso_3],
    AutoSend=False,
    BaseId="071c29f03a8a9476b9545c3f7329f907",
    CurrentComponentState="expired",
    KitName="Objects",
    OutputWrappers="https://macad.speckle.xyz\t4975f9f0a8\t6980ae4db7",
    UseDefaultCache=True,
    selectedKitName="Objects")

test = Panel("https://macad.speckle.xyz/projects/708456778c/models/f3d86338e5")

concatenate_5 = Concatenate(FragmentA="Rev no -", FragmentB="02")
site_mapping = Panel("https://macad.speckle.xyz/projects/708456778c/models/3073ca1f8c")

concatenate_6 = Concatenate(A=concatenate_5, D=" / ", B="13-March-2024", E=" // ", C="G14 site")

send_5 = Send(
    Stream=[test, site_mapping],
    Message=concatenate_6,
    O=cso_3,
    AutoSend=False,
    BaseId="32268f057b59aeced876db45f3f85395",
    CurrentComponentState="up_to_date",
    KitName="Objects",
    OutputWrappers="""https://macad.speckle.xyz	708456778c	cc88a471df
https://macad.speckle.xyz	708456778c	ebf7b8534b""",
    UseDefaultCache=True,
    selectedKitName="Objects")

# ----
# Site_Mapping: https://macad.speckle.xyz/projects/708456778c/models/3073ca1f8c
receive_3 = Receive(
    Stream=site_mapping,
    AutoReceive=True,
    CurrentComponentState="expired",
    ExpandOutput=True,
    ReceiveOnOpen=False,
    ReceivedCommitId="911636588e",
    StreamWrapper="https://macad.speckle.xyz/projects/708456778c/models/3073ca1f8c",
    selectedKitName="Objects")  # -> Info, O
deconstruct_speckle_object = DeconstructSpeckleObject(SpeckleObject=receive_3.O, selectedKitName="Objects")
group_toggle = GroupToggle(ToggleActive=True, ToggleVisible=False)  # disabled

list_item = ListItem(List=deconstruct_speckle_object, Index=0, Wrap=True)  # -> Item, Item1, Item2, Item3, Item4
geometry = Geometry(list_item.Item)
geometry_2 = Geometry(list_item.Item1)
geometry_3 = Geometry(list_item.Item2)
geometry_4 = Geometry(list_item.Item3)
geometry_5 = Geometry(list_item.Item4)

# ==== cluster ClusterAndFloorNumbering

# ---- group: Cluster Input
number_of_floor = ClusterInput()  # Give the total number of floor

start_floor = ClusterInput()  # Start Floor

# ----
series = Series(Start=start_floor, Step=1, Count=number_of_floor)
expression = Expression(x=series, Expression="Format(\"{0:00}\", x)")

# ---- group: Cluster Input
cluster_number = ClusterInput()  # Naming cluster number

# ----
larger_than = LargerThan(FirstNumber=cluster_number, SecondNumber=expr("1", 0))  # -> LargerThan, OrEqualTo
concat = Concatenate(FragmentA="L", FragmentB=expression)  # -> simplify(graft(Result))
concat_2 = Concatenate(FragmentA="C", FragmentB=cluster_number)
filter = StreamFilter(Gate=larger_than.OrEqualTo, Stream0="ZZ", Stream1=concat_2)
filter_2 = StreamFilter(Gate=larger_than.OrEqualTo, Stream0="ZZ", Stream1=concat)
cluster_number_2 = Text(filter)
floor_number = Text(filter_2)

# ---- group: Cluster Output
cluster_number_3 = ClusterOutput(cluster_number_2)

floor_number_2 = ClusterOutput(floor_number)
